# Grasshopper definition simple.gh (Grasshopper 1.0.7)

typology = GetString("courtyard", AtLeast=1, AtMost=1, TreeAccess=False)  # disabled

# ---- group: RH_IN:typology
txt = Text("courtyard")

# ----
cir = Circle(Plane=PlaneXY(0, 0, 0), Radius=1)
ln = Line(StartPoint=Point(-1, 0, 0), EndPoint=Point(1, 0, 0))
list = ValueList({"Line": 0, "Circle": 1}, selected="Circle")
divide = DivideCurve(Curve=cir, Count=10, Kinks=False)  # -> Points, Tangents, Parameters
divide_2 = DivideCurve(Curve=ln, Count=10, Kinks=False)  # -> Points, Tangents, Parameters
tmatch = MatchText(Text=txt, RegEx="courtyard", Case=True)
filter = StreamFilter(Gate=tmatch, Stream0=divide_2.Points, Stream1=divide.Points)
panel = Panel(tmatch)
context_bake = ContextBake(Geometry=filter)
context_print = ContextPrint(Text=filter)  # disabled
