# Grasshopper definition x1000.gh (Grasshopper 1.0.7)

integer = GetInteger("2", AtLeast=1, AtMost=1, Maximum=2147483647, Minimum=-2147483648, TreeAccess=False)  # disabled

# ---- group: RH_IN:integer
int = Integer("2")

# ----
multiplication = Multiplication(A=int, B=1000)
context_print = ContextPrint(Text=multiplication)
