# Grasshopper definition twisty.gh (Grasshopper 1.0.7)

rotate = Slider(109, range=0..360)
height = Slider(7, range=0..100)
circle = Circle({Plane=PlaneXY(0, 0, 0), Radius=5})
curve = GetGeometry(circle, AtLeast=1, AtMost=2147483647, DeleteInput=False, Filter=1073741828, TreeAccess=False)
Z = UnitZ(Factor=height)
rotate_2 = GetNumber(rotate, AtLeast=1, AtMost=2147483647, Maximum=1.797693135e+308, Minimum=-1.797693135e+308, TreeAccess=False)
move = Move(Geometry=curve, Motion=Z)  # -> Geometry, Transform
rad = Radians(Degrees=rotate_2)
rotate_3 = Rotate(Geometry=move.Geometry, Angle=rad, Plane=PlaneXY(0, 0, 0))  # -> Geometry, Transform
divide = DivideCurve(Curve=curve, Count=10, Kinks=False)  # -> Points, Tangents, Parameters
divide_2 = DivideCurve(Curve=rotate_3.Geometry, Count=10, Kinks=False)  # -> Points, Tangents, Parameters
ln = Line(StartPoint=divide.Points, EndPoint=divide_2.Points)

# ---- group: RH_OUT:lines
crv = Curve(ln)
